# Dynamo graph chess board points.dyn (Dynamo 2.5.0.7460)

number_slider = DoubleSlider(0, range=0..50 step 1)
byCoordinates = Point.ByCoordinates(z=number_slider)
number_slider_2 = DoubleSlider(8, range=0..50 step 1)
byCenterPointRadius = Circle.ByCenterPointRadius(centerPoint=byCoordinates, radius=number_slider_2)
number_slider_3 = DoubleSlider(10, range=0..50 step 1)
byCoordinates_2 = Point.ByCoordinates(z=number_slider_3)
number_slider_4 = DoubleSlider(2, range=0..50 step 1)
byCenterPointRadius_2 = Circle.ByCenterPointRadius(centerPoint=byCoordinates_2, radius=number_slider_4)
number_slider_5 = DoubleSlider(15, range=0..50 step 1)
byCoordinates_3 = Point.ByCoordinates(z=number_slider_5)
number_slider_6 = DoubleSlider(5, range=0..50 step 1)
byCenterPointRadius_3 = Circle.ByCenterPointRadius(centerPoint=byCoordinates_3, radius=number_slider_6)

# group: Solid Loft
list_create = List.Create(item0=byCenterPointRadius, item1=byCenterPointRadius_2, item2=byCenterPointRadius_3)
byLoft = Solid.ByLoft(crossSections=list_create)
edges = Topology.Edges(topology=byLoft)
number_slider_7 = DoubleSlider(2, range=0..50 step 1)
fillet = Solid.Fillet(solid=byLoft, edges=edges, radius=number_slider_7)

# group: Solid/Sweep
pointAtParameter = Curve.PointAtParameter(curve=byCenterPointRadius_2)
number_slider_8 = DoubleSlider(0.75, range=0..100 step 0.1)
tangentAtParameter = Curve.TangentAtParameter(curve=byCenterPointRadius_2)
byCenterPointRadiusNormal = Circle.ByCenterPointRadiusNormal(centerPoint=pointAtParameter, radius=number_slider_8, normal=tangentAtParameter)
bySweep = Solid.BySweep(profile=byCenterPointRadiusNormal, path=byCenterPointRadius_2)
